# Requirement set reqs (R2024b)

## 1 [FSR1] Activate when signalled.
The brake lamps shall be activated within 50ms of receiving a brake signal.

## 2 [FSR2] Activate when accelerating negatively.
The brake lamps shall be activated if the acceleration of the vehicle is measured to be > 1.3 m/s^2 while the vehicle is in regenerative braking (one pedal) mode and shall remain activated until the acceleration is measured to be <= 1.2 m/s^2, or when the measured pressure on the brake pedal is below 40% maximum depression.

## 3 [FSR3] Do not activate when signalling and unified lamps are configured.
The brake lamps shall not be activated if a turn signal is active. In the case that the system is not configured for unified brake and rear turn signals, this requirement shall not be considered.

## 4 [FSR4] Logic unit detects faults in itself.
Faults in the logic unit, which would lead to an unintended activation of brake lamps, shall be detected within 50ms.

## 5 [FSR5] Logic unit detects unintended non-illumination.
Faults in the logic unit or brake lamp feedback, which would lead to a failure to illuminate when signaling, if the system is configured for unified braking and turning lamps, or braking, shall be detected within 50ms.